# Grasshopper definition Blog Cameron Direct Manipulation flow v2.gh (Grasshopper 1.0.7)
# plug-ins: Fologram For Grasshopper Utilities, FologramForGrasshopper, Pufferfish

# https://community.fologram.com/t/direct-manipulation-flow-in-grashopper-triggers-recursive-loop/1079/2
syncparams = SyncParameters(
    augmented_trigger_0_key=number_slider,
    augmented_trigger_1_key=update_points,
    augmented_trigger_3_key=random_range,
    componentVersion=1,
    num_augmented_triggers=4)
devices = ConnectedDevices(device_filter=3, hasSerializedData=True)
update_points = Button()
number_slider = Slider(11, range=0..50)
state = TrackState(Device=devices, hasSerializedData=True, update_mode=1)
get_global = GetGlobalValue(IsDynamicUpdate=False)
check_release_state = PythonScript(x=state)  # -> a; inputs x: list
# ---------- check_release_state: Python ----------
if 'Release' in x:
    a = True
else:
    a = False

## Make persistent value to keep track of last value
#if "lastValue" not in globals():
#    lastValue = x
## Check that current value is different from last value
#if lastValue == x:
#    a = False
#else:
#    if x == 'Release':
#        a = True
#    a = False
#    lastValue = x
# ---------- end check_release_state ----------
pop3d = Populate3D(Region={Plane=PlaneXY(0, 0, 0), X=Domain(0, 10), Y=Domain(0, 10), Z=Domain(0, 2)}, Count=number_slider, Seed=1)
gate = StreamGate(Stream=get_global, Gate=check_release_state)  # -> Target0, Target1
sph = Sphere(Base=pop3d, Radius=1)
sync = SyncObject(
    GM=[gate.Target1, gate.Target0],
    AlwaysIncludeTextureCoordinates=False,
    Clickable=True,
    DefaultCurveThicknessMillimeters=2.5,
    DefaultGlossPercent=0,
    DefaultMaterialColor=RGB(255, 255, 255),
    DefaultSpecularPercent=0,
    Grabbable=False,
    Interactive=True,
    Occlusion=False,
    Outline=False,
    hasSerializedData=True)
set_global = SetGlobalValue(Global=sph)
taps = TrackTaps(Devices=flatten(devices), Geometry=flatten(sync), IncludeEmptyTaps=False, hasSerializedData=True, update_mode=2)  # -> Device, Index
srf = Surface(sync)
item = ListItem(List=srf, Index=taps.Index, Wrap=True)
lng = ListLength(List=srf)
area = Area(Geometry=item)  # -> Area, Centroid
random_range = Slider(3.2, range=-1.001..10)
get_random_displacements = PythonScript(num_vecs=lng, random_range=random_range)  # -> a; inputs num_vecs: Int32
# ---------- get_random_displacements: Python ----------
import random
import Rhino.Geometry as rg

a = [rg.Vector3d(random.uniform(0, random_range), random.uniform(0, random_range), random.uniform(0, random_range)) for _ in range(num_vecs)]
# ---------- end get_random_displacements ----------
area_2 = Area(Geometry=srf)  # -> Area, Centroid
addition = Addition(A=area.Centroid, B=get_random_displacements)
move2pt = MoveToPoint(Geometry=srf, PointA=area_2.Centroid, PointB=addition)  # -> Moved, Vector, Transform
set_global_2 = SetGlobalValue(Global=move2pt.Moved)
