# Grasshopper definition Blog Cameron Direct Manipulation flow.gh (Grasshopper 1.0.7)
# plug-ins: Fologram For Grasshopper Utilities, FologramForGrasshopper

# https://community.fologram.com/t/direct-manipulation-flow-in-grashopper-triggers-recursive-loop/1079/2
syncparams = SyncParameters(
    augmented_trigger_0_key=number_slider,
    augmented_trigger_1_key=update_points,
    componentVersion=1,
    num_augmented_triggers=2)
number_slider = Slider(18, range=0..50)
devices = ConnectedDevices(device_filter=3, hasSerializedData=True)
update_points = Button()
get_global = GetGlobalValue(IsDynamicUpdate=False)
state = TrackState(Device=devices, hasSerializedData=True, update_mode=1)
pop3d = Populate3D(Region={Plane=PlaneXY(0, 0, 0), X=Domain(0, 10), Y=Domain(0, 10), Z=Domain(0, 2)}, Count=number_slider, Seed=1)
gate = StreamGate(Stream=get_global, Gate=update_points)  # -> Target0, Target1
sph = Sphere(Base=pop3d, Radius=1)
sync = SyncObject(
    GM=[gate.Target1, gate.Target0],
    AlwaysIncludeTextureCoordinates=False,
    Clickable=False,
    DefaultCurveThicknessMillimeters=2.5,
    DefaultGlossPercent=0,
    DefaultMaterialColor=RGB(255, 255, 255),
    DefaultSpecularPercent=0,
    Grabbable=False,
    Interactive=True,
    Occlusion=False,
    Outline=False,
    hasSerializedData=True)
set_global = SetGlobalValue(Global=sph)
srf = Surface(sync)
set_global_2 = SetGlobalValue(Global=srf)
