# Grasshopper definition SpiralDemo.gh (Grasshopper 1.0.7)
# plug-ins: FologramForGrasshopper, Fologram For Grasshopper Utilities

syncparams = SyncParameters(
    augmented_trigger_4_key=number_slider_2,
    augmented_trigger_5_key=number_slider_4,
    augmented_trigger_6_key=number_slider_3,
    augmented_trigger_7_key=number_slider,
    augmented_trigger_8_key=number_slider_5,
    componentVersion=1,
    num_augmented_triggers=10)
number_slider = Slider(5, range=1..50)
number_slider_2 = Slider(123.75, range=0..200)
number_slider_3 = Slider(10, range=1..50)
number_slider_4 = Slider(10, range=0..10)
pt = ConstructPoint(XCoordinate=0, YCoordinate=0, ZCoordinate=0)
connected_devices = ConnectedDevices(device_filter=3, hasSerializedData=True)
toolpath_unit_generator = GhPythonScript(
    position=pt,
    initialRadius=number_slider_2,
    layerHeight=number_slider_4,
    nbLayers=number_slider_3,
    nbPointsInLayer=number_slider)  # -> out, path; inputs position: Point3d, nbLayers: Int32, nbPointsInLayer: Int32
# ---------- toolpath_unit_generator: Python ----------
__author__ = "sami_"
__version__ = "2022.06.29"

import rhinoscriptsyntax as rs
import math

print(selectedIndex)

path = []
nbPoints = nbPointsInLayer 
radius = initialRadius

vectors = []
for j in range(0, nbLayers):
    for i in range(0, nbPoints):
        angle = 360/nbPoints
        path.append(rs.CreatePoint(position.X + radius*math.cos(i*angle*math.pi/180), position.Y + radius*math.sin(i*angle*math.pi/180), position.Z+layerHeight*j))
# ---------- end toolpath_unit_generator ----------
number_slider_5 = Slider(2.319, range=0..3)
panel = Panel(toolpath_unit_generator.out)
msphere = MeshSphere(Base=toolpath_unit_generator.path, Radius=number_slider_5, UCount=10, VCount=20)
sync = SyncObject(
    GM=msphere,
    AlwaysIncludeTextureCoordinates=False,
    Clickable=True,
    DefaultCurveThicknessMillimeters=2.5,
    DefaultGlossPercent=0,
    DefaultMaterialColor=RGB(196, 155, 155),
    DefaultSpecularPercent=0,
    Grabbable=True,
    Interactive=False,
    Occlusion=False,
    Outline=False,
    hasSerializedData=True)
track_taps = TrackTaps(Devices=graft(connected_devices), Geometry=flatten(sync), IncludeEmptyTaps=False, hasSerializedData=True, update_mode=2)  # -> Device, Index
mesh = Mesh(sync)
area = Area(Geometry=mesh)  # -> Area, Centroid
list_item = ListItem(List=sync, Index=track_taps.Index, Wrap=True)
C = Counter(Trigger=track_taps.Index)
pline = PolyLine(Vertices=area.Centroid, Closed=False)
mesh_2 = Mesh(list_item)
panel_2 = Panel(C)
panel_3 = Panel(track_taps.Index)
area_2 = Area(Geometry=mesh_2)  # -> Area, Centroid
sync_2 = SyncObject(
    GM=pline,
    AlwaysIncludeTextureCoordinates=False,
    Clickable=False,
    DefaultCurveThicknessMillimeters=2.799999952,
    DefaultGlossPercent=0,
    DefaultMaterialColor=RGB(255, 255, 255),
    DefaultSpecularPercent=0,
    Grabbable=False,
    Interactive=False,
    Occlusion=False,
    Outline=False,
    hasSerializedData=True)
panel_4 = Panel(area_2.Centroid)
combine = CombineData(Input0=area_2.Centroid, Input1=track_taps.Index)  # -> Result, Index
panel_5 = Panel(combine.Result)
