# Grasshopper definition basic_functions.gh (Grasshopper 1.0.7)
# plug-ins: FologramForGrasshopper, Fologram For Grasshopper Utilities

syncparams = SyncParameters(
    augmented_trigger_10_key=brush_style,
    augmented_trigger_11_key=brushsize_height,
    augmented_trigger_12_key=number_slider_5,
    augmented_trigger_13_key=brushsize_width,
    augmented_trigger_4_key=number_slider_2,
    augmented_trigger_5_key=number_slider_4,
    augmented_trigger_6_key=number_slider,
    augmented_trigger_7_key=number_slider_3,
    augmented_trigger_8_key=number_slider_6,
    componentVersion=1,
    num_augmented_triggers=14)
number_slider = Slider(11, range=1..50)
number_slider_2 = Slider(85.616, range=0..200)
number_slider_3 = Slider(20, range=1..50)
number_slider_4 = Slider(5.652, range=0..10)
pt = ConstructPoint(XCoordinate=0, YCoordinate=0, ZCoordinate=0)

# ---- group: Detect release
connected_devices = ConnectedDevices(device_filter=3, hasSerializedData=True)
track_state = TrackState(Device=connected_devices, hasSerializedData=True, update_mode=1)
state_gate = StateGate(States=track_state)

# ----
number_slider_5 = Slider(91, range=0..200)
brush_style = ValueList({"Linear": 0, "Exponential": 1}, selected="Linear")
toolpath_unit_generator = GhPythonScript(
    position=pt,
    initialRadius=number_slider_2,
    layerHeight=number_slider_4,
    nbLayers=number_slider,
    nbPointsInLayer=number_slider_3)  # -> out, path; inputs position: Point3d, nbLayers: Int32, nbPointsInLayer: Int32
# ---------- toolpath_unit_generator: Python ----------
__author__ = "sami_"
__version__ = "2022.06.29"

import rhinoscriptsyntax as rs
import math

print(selectedIndex)

path = []
nbPoints = nbPointsInLayer 
radius = initialRadius

vectors = []
for j in range(0, nbLayers):
    for i in range(0, nbPoints):
        angle = 360/nbPoints
        path.append(rs.CreatePoint(position.X + radius*math.cos(i*angle*math.pi/180), position.Y + radius*math.sin(i*angle*math.pi/180), position.Z+layerHeight*j))
# ---------- end toolpath_unit_generator ----------
brushsize_height = Slider(1, range=0.001..1)
brushsize_width = Slider(33.037, range=1..90)
number_slider_6 = Slider(2.319, range=0..3)

# ---- group: Update on release
new = GetGlobalValue(IsDynamicUpdate=False)  # disabled
state = SetGlobalValue(Global=new)  # disabled

# ----
panel = Panel(toolpath_unit_generator.out)
msphere = MeshSphere(Base=toolpath_unit_generator.path, Radius=number_slider_6, UCount=10, VCount=20)
set_global = SetGlobalValue(Global=msphere)

get_global = GetGlobalValue(IsDynamicUpdate=True)
sync = SyncObject(
    GM=get_global,
    AlwaysIncludeTextureCoordinates=False,
    Clickable=True,
    DefaultCurveThicknessMillimeters=2.5,
    DefaultGlossPercent=0,
    DefaultMaterialColor=RGB(196, 155, 155),
    DefaultSpecularPercent=0,
    Grabbable=True,
    Interactive=True,
    Occlusion=False,
    Outline=False,
    hasSerializedData=True)
mesh = Mesh(sync)
area = Area(Geometry=mesh)  # -> Area, Centroid

taps = TrackTaps(
    Devices=flatten(connected_devices),
    Geometry=flatten(sync),
    IncludeEmptyTaps=False,
    hasSerializedData=True,
    update_mode=2)  # -> Device, Index
python = GhPythonScript(
    selected=taps.Index,
    points=area.Centroid,
    layers=number_slider,
    layerHeight=number_slider_4,
    pointsInLayers=number_slider_3,
    brushSizeZ=brushsize_height,
    brushWidth=brushsize_width,
    bStyle=brush_style)  # -> out, a; inputs selected: Int32, points: list of Point3d, pointsInLayers: Int32
# ---------- python: Python ----------
"""Provides a scripting component.
    Inputs:
        selected: the point thta was selected/dragged by the user
        points: the list of all points
        layers: number of layers (rows)
        pointsInLayers: number of points in each layer ()columns
        bSize: size of "brush" or user manipulation
        bStyle: size of "brush" or user manipulation
    Output:
        a: The a output variable"""

__author__ = "joyce"
__version__ = "2023.05.22"

import rhinoscriptsyntax as rs

def distXY(p0, p1):
  return (p0.X- p1.X)*(p0.X- p1.X) + (p0.Y- p1.Y)*(p0.Y- p1.Y)#+(p0.Z- p1.Z)*(p0.Z- p1.Z)

def colTransform():       
    column = selected%pointsInLayers
#    print(column)
    
#    cols = points[column::pointsInLayers]
#    print[len(cols)]
        
    newX, newY = points[selected].X, points[selected].Y
    print(newX, newY)
    
    for i in range(pointsInLayers):
        if(abs(i-column) < brushWidth*pointsInLayers/360):
            for c in points[i::pointsInLayers]:
                if(not c == points[selected]):
                    if(bStyle == 0):    
                        cdist = max(0, abs(i-column)/(brushWidth/360*pointsInLayers))
                        dist = min(1,abs(c.Z - points[selected].Z)/layerHeight/layers/brushSizeZ)
                    elif(bStyle == 1):
                        dist = pow(min(1,abs(c.Z - points[selected].Z)/layerHeight/layers/brushSizeZ), 2)
                        cdist = pow(max(0, abs(i-column)/(brushWidth/360*pointsInLayers)),2)   
                    
                    weight = min(dist + cdist, 1)
                    c.X =  (newX*(1-weight) + c.X*weight)
                    c.Y =  (newY*(1-weight) + c.Y*weight)
#                    print(dist)
#            print("lin")


if(selected is not None):
#    print("Selected")
#    
#    points[selected].X -= 50 
#    points[selected].Y += 50

    colTransform()
    
a = points
# ---------- end python ----------
panel_2 = Panel(python.out)
points = PointList(Points=python.a)
msphere_2 = MeshSphere(Base=python.a, Radius=number_slider_6, UCount=10, VCount=20)
new_2 = SetGlobalValue(Global=msphere_2)

pline = PolyLine(Vertices=python.a, Closed=False)
sync_2 = SyncObject(
    GM=pline,
    AlwaysIncludeTextureCoordinates=False,
    Clickable=False,
    DefaultCurveThicknessMillimeters=2.799999952,
    DefaultGlossPercent=0,
    DefaultMaterialColor=RGB(255, 255, 255),
    DefaultSpecularPercent=0,
    Grabbable=False,
    Interactive=False,
    Occlusion=False,
    Outline=False,
    hasSerializedData=True)
