# Grasshopper definition drag_update.gh (Grasshopper 1.0.7)
# plug-ins: FologramForGrasshopper, Fologram For Grasshopper Utilities

# ---- group: Initial Condition
populate_3d = Populate3D(
    Region={Plane=Plane(origin=(0, 300, 0), x=(1, 0, 0), y=(0, -1, 0)), X=Domain(0, 300), Y=Domain(0, 300), Z=Domain(-300, 0)},
    Count=Slider(15, range=0..100),
    Seed=1)
sphere = Sphere(Base=populate_3d, Radius=Slider(50, range=0..100))
state = SetGlobalValue(Global=sphere)

# ---- group: Detect release
connected_devices = ConnectedDevices(device_filter=3, hasSerializedData=True)
track_state = TrackState(Device=connected_devices, hasSerializedData=True, update_mode=1)
state_gate = StateGate(States=track_state)

# ---- group: Preview and update
get_global_value = GetGlobalValue(IsDynamicUpdate=True)
sync_object = SyncObject(
    GM=get_global_value,
    AlwaysIncludeTextureCoordinates=False,
    Clickable=False,
    DefaultCurveThicknessMillimeters=2.5,
    DefaultGlossPercent=0,
    DefaultMaterialColor=RGB(255, 255, 255),
    DefaultSpecularPercent=0,
    Grabbable=True,
    Interactive=False,
    Occlusion=False,
    Outline=False,
    hasSerializedData=True)
surface = Surface(sync_object)
vector = Vector(Vector(0, 0, 48.84868421))
move = Move(Geometry=surface, Motion=vector)  # -> Geometry, Transform
set_global_value = SetGlobalValue(Global=move.Geometry)

# ---- group: Update on release
new = GetGlobalValue(IsDynamicUpdate=False)  # disabled
state_2 = SetGlobalValue(Global=new)  # disabled
