# Grasshopper definition drag_update_v2.gh (Grasshopper 1.0.7)
# plug-ins: FologramForGrasshopper, Fologram For Grasshopper Utilities

# ---- group: Initial Condition
populate_3d = Populate3D(
    Region={Plane=Plane(origin=(0, 300, 0), x=(1, 0, 0), y=(0, -1, 0)), X=Domain(0, 300), Y=Domain(0, 300), Z=Domain(-300, 0)},
    Count=Slider(6, range=0..100),
    Seed=1)
state = SetGlobalValue(Global=populate_3d)

# ---- group: Detect release
connected_devices = ConnectedDevices(device_filter=3, hasSerializedData=True)
track_state = TrackState(Device=connected_devices, hasSerializedData=True, update_mode=1)
state_gate = StateGate(States=track_state)

# ---- group: Preview and update
# Trying to only change it when it updates but does not seem to work
number_slider = Slider(24, range=0..100)
get_global_value = GetGlobalValue(IsDynamicUpdate=True)
sphere = Sphere(Base=get_global_value, Radius=number_slider)
sync_object = SyncObject(
    GM=sphere,
    AlwaysIncludeTextureCoordinates=False,
    Clickable=True,
    DefaultCurveThicknessMillimeters=2.5,
    DefaultGlossPercent=0,
    DefaultMaterialColor=RGB(255, 255, 255),
    DefaultSpecularPercent=0,
    Grabbable=True,
    Interactive=False,
    Occlusion=False,
    Outline=False,
    hasSerializedData=True)
taps = TrackTaps(
    Devices=flatten(connected_devices),
    Geometry=flatten(sync_object),
    IncludeEmptyTaps=False,
    hasSerializedData=True,
    update_mode=2)  # -> Device, Index
item = ListItem(List=sync_object, Index=taps.Index, Wrap=True)
lng = ListLength(List=sync_object)
surface = Surface(item)
random_range = Slider(84, range=50..200)
area = Area(Geometry=surface)  # -> Area, Centroid
python = PythonScript(x=area.Centroid)  # -> a, b; inputs x: list
# ---------- python: Python ----------
# Make persistent value to keep track of last value
if "lastValue" not in globals():
    lastValue = x
    b = None

if lastValue == x:
    a = False
    b = None
else:
    a = True
    b = x
# ---------- end python ----------
clone_centroid = PythonScript(centroid=area.Centroid, n=lng)  # -> result; inputs centroid: Point3d, n: Int32
# ---------- clone_centroid: Python ----------
result = [centroid for _ in range(n)]
# ---------- end clone_centroid ----------
get_random_displacements = PythonScript(num_vecs=lng, random_range=random_range)  # -> a; inputs num_vecs: Int32
# ---------- get_random_displacements: Python ----------
import random
import Rhino.Geometry as rg

a = [rg.Vector3d(random.uniform(0, random_range), random.uniform(0, random_range), random.uniform(0, random_range)) for _ in range(num_vecs)]
# ---------- end get_random_displacements ----------
sphere_2 = Sphere(Base=clone_centroid, Radius=number_slider)
addition = Addition(A=clone_centroid, B=get_random_displacements)
set_global_value = SetGlobalValue(Global=addition)

# ---- group: Update on release
new = GetGlobalValue(IsDynamicUpdate=False)  # disabled
state_2 = SetGlobalValue(Global=new)  # disabled
