# Grasshopper definition drag_update_v5.gh (Grasshopper 1.0.7)
# plug-ins: Fologram For Grasshopper Utilities, FologramForGrasshopper

# ---- group: Detect release
connected_devices = ConnectedDevices(device_filter=3, hasSerializedData=True)
track_state = TrackState(Device=connected_devices, hasSerializedData=True, update_mode=1)
state_gate = StateGate(States=track_state)  # -> Press, Release

# ----
get_global_value = GetGlobalValue(IsDynamicUpdate=True)
sync_object = SyncObject(
    GM=get_global_value,
    AlwaysIncludeTextureCoordinates=False,
    Clickable=False,
    DefaultCurveThicknessMillimeters=2.5,
    DefaultGlossPercent=0,
    DefaultMaterialColor=RGB(255, 255, 255),
    DefaultSpecularPercent=0,
    Grabbable=True,
    Interactive=False,
    Occlusion=False,
    Outline=False,
    hasSerializedData=True)
mesh = Mesh(sync_object)
set_global_value = SetGlobalValue(Global=mesh)

# ----
# I can detect when a way touches the sphere
#  but only when the touch starts
# Using the data recorder I can persist the
# interactions when the user starts the tap
pointers = TrackPointers(Device=connected_devices, hasSerializedData=True, update_mode=1)  # disabled
line = Line(pointers)  # disabled
end = EndPoints(Curve=line)  # -> Start, End; disabled
vec2pt = Vector2Pt(PointA=end.Start, PointB=end.End, Unitize=False)  # -> Vector, Length; disabled
meshray = MeshRay(Mesh=mesh, Point=end.Start, Direction=vec2pt.Vector)  # -> Point, Hit; disabled
intersection_index = GhPythonScript(x=meshray.Hit)  # -> out, index; inputs x: list; disabled
# ---------- intersection_index: Python ----------
__author__ = "Ana"
__version__ = "2023.05.26"

import rhinoscriptsyntax as rs

index = None
for i, val in enumerate(x):
    if(val):
        index = i
# ---------- end intersection_index ----------
panel = Panel("-1")  # disabled
rec = DataRecorder(intersection_index.index, DataLimit=-10, RecordData=True)  # disabled
item = ListItem(List=rec, Index=panel, Wrap=True)  # disabled
item_2 = ListItem(List=mesh, Index=item, Wrap=True)  # disabled
panel_2 = Panel(rec)  # disabled
set_global = SetGlobalValue(Global=item)  # disabled
area = Area(Geometry=item_2)  # -> Area, Centroid; disabled
set_global_2 = SetGlobalValue(Position=area.Centroid)  # disabled

# ---- group: Initial Condition
number_slider = Slider(33, range=0..100)
populate_3d = Populate3D(
    Region={Plane=Plane(origin=(0, 300, 0), x=(1, 0, 0), y=(0, -1, 0)), X=Domain(0, 300), Y=Domain(0, 300), Z=Domain(-300, 0)},
    Count=Slider(42, range=1..50),
    Seed=1)

# ----
get_global = GetGlobalValue(IsDynamicUpdate=False)  # disabled
get_global_2 = GetGlobalValue(IsDynamicUpdate=False)  # disabled
get_global_3 = GetGlobalValue(IsDynamicUpdate=False)  # disabled
area_2 = Area(Geometry=get_global)  # -> Area, Centroid; disabled
panel_3 = Panel(get_global_2)  # disabled
move_points = GhPythonScript(points=area_2.Centroid, selected=get_global_2, oldPos=get_global_3)  # -> out, a; inputs points: list of Point3d, selected: Int32, oldPos: Point3d; disabled
# ---------- move_points: Python ----------
__author__ = "Ana"
__version__ = "2023.06.01"

def pointsTransform():
    newX, newY = points[selected].X, points[selected].Y
    print(newX, newY)
    deltaX, deltaY = oldPos.X - newX, oldPos.Y - newY
    for p in points:
     if (not p == points[selected]):
         p.X = p.X - deltaX
         p.Y = p.Y - deltaY
if(selected is not None):
    pointsTransform()
    
a = points

#print(points)
print(selected)
#print(oldPos)
# ---------- end move_points ----------
msphere = MeshSphere(Base=flatten(move_points.a), Radius=number_slider, UCount=10, VCount=20)  # disabled
state = SetGlobalValue(Global=msphere)  # disabled

msphere_2 = MeshSphere(Base=populate_3d, Radius=number_slider, UCount=10, VCount=20)

# ---- group: Initial Condition (continued)
state_2 = SetGlobalValue(Global=msphere_2)
