# Grasshopper definition hand_tracking.gh (Grasshopper 1.0.7)
# plug-ins: Fologram For Grasshopper Utilities, FologramForGrasshopper

# ---- group: Detect release
# This event is not triggered with hand gestures
connected_devices = ConnectedDevices(device_filter=3, hasSerializedData=True)
track_state = TrackState(Device=connected_devices, hasSerializedData=True, update_mode=1)
state_gate = StateGate(States=track_state)

# ----
# Detect tap behavior with hands, it's not a single event like "Release"
# Deetct object that was clicked. Only works at the start not during the update as the user drags the object
connected_devices_2 = ConnectedDevices(device_filter=3, hasSerializedData=True)
finger = ValueList({"Right": 1, "Left": 0}, selected="Right")
track_hands = TrackHands(Device=connected_devices_2, hasSerializedData=True, update_mode=1)
finger_2 = ValueList({"Thumb": 2, "Index": 7, "Middle": 12, "Ring": 17, "Pinky": 22}, selected="Index")
finger_3 = ValueList({"Thumb": 2, "Index": 7, "Middle": 12, "Ring": 17, "Pinky": 22}, selected="Thumb")
branch = TreeBranch(Tree=track_hands, Path=finger, MaintainPaths=True)
item = ListItem(List=branch, Index=expr("x + 3", finger_2), Wrap=True)
item_2 = ListItem(List=branch, Index=expr("x + 3", finger_3), Wrap=True)
item_3 = ListItem(List=branch, Index=finger_2, Wrap=True)
dist = Distance(PointA=item, PointB=item_2)
vec2pt = Vector2Pt(PointA=item_3, PointB=item, Unitize=False)  # -> Vector, Length
get_global = GetGlobalValue(IsDynamicUpdate=True)
smaller = SmallerThan(FirstNumber=dist, SecondNumber="10")  # -> SmallerThan, OrEqualTo
meshray = MeshRay(Mesh=get_global, Point=item_3, Direction=vec2pt.Vector)  # -> Point, Hit
panel = Panel(smaller.SmallerThan)
intersection_index = GhPythonScript(x=meshray.Point)  # -> out, index; inputs x: list
# ---------- intersection_index: Python ----------
__author__ = "Ana"
__version__ = "2023.05.26"

import rhinoscriptsyntax as rs

index = None
for i, val in enumerate(x):
    if(val):
        index = i
# ---------- end intersection_index ----------
panel_2 = Panel(intersection_index.index)
set_global = SetGlobalValue(Selected=intersection_index.index)

number_slider = Slider(7, range=1..50)
number_slider_2 = Slider(10, range=1..50)
number_slider_3 = Slider(100, range=0..100)
pt = ConstructPoint(XCoordinate=Slider(100.523, range=0..200), YCoordinate=Slider(100.523, range=0..200), ZCoordinate=0)
toolpath_unit_generator = GhPythonScript(
    position=pt,
    initialRadius=Slider(83.523, range=0..200),
    layerHeight=number_slider_3,
    nbLayers=number_slider_2,
    nbPointsInLayer=number_slider)  # -> out, path; inputs position: Point3d, nbLayers: Int32, nbPointsInLayer: Int32
# ---------- toolpath_unit_generator: Python ----------
__author__ = "sami_"
__version__ = "2022.06.29"

import rhinoscriptsyntax as rs
import math

print(selectedIndex)

path = []
nbPoints = nbPointsInLayer 
radius = initialRadius

vectors = []
for j in range(0, nbLayers):
    for i in range(0, nbPoints):
        angle = 360/nbPoints
        path.append(rs.CreatePoint(position.X + radius*math.cos(i*angle*math.pi/180), position.Y + radius*math.sin(i*angle*math.pi/180), position.Z+layerHeight*j))
# ---------- end toolpath_unit_generator ----------

# ---- group: Update on release
new = GetGlobalValue(IsDynamicUpdate=False)  # disabled
state = SetGlobalValue(Global=new)  # disabled

# ----
number_slider_4 = Slider(7.294, range=0..10)
panel_3 = Panel(toolpath_unit_generator.out)
msphere = MeshSphere(Base=toolpath_unit_generator.path, Radius=number_slider_4, UCount=10, VCount=20)
set_global_2 = SetGlobalValue(Global=msphere)
number_slider_5 = Slider(89, range=0..200)
brush_style = ValueList({"Linear": 0, "Exponential": 1}, selected="Linear")
brushsize_height = Slider(0.277, range=0.001..1)
brushsize_width = Slider(51.593, range=1..90)
get_global_2 = GetGlobalValue(IsDynamicUpdate=False)
panel_4 = Panel(get_global_2)

# ----
# Taps component is also not working with the hand gestures
get_global_3 = GetGlobalValue(IsDynamicUpdate=True)
sync = SyncObject(
    GM=get_global_3,
    AlwaysIncludeTextureCoordinates=False,
    Clickable=True,
    DefaultCurveThicknessMillimeters=2.5,
    DefaultGlossPercent=0,
    DefaultMaterialColor=RGB(196, 155, 155),
    DefaultSpecularPercent=0,
    Grabbable=True,
    Interactive=True,
    Occlusion=False,
    Outline=False,
    hasSerializedData=True)
mesh = Mesh(sync)
area = Area(Geometry=mesh)  # -> Area, Centroid

taps = TrackTaps(Geometry=flatten(sync), IncludeEmptyTaps=False, hasSerializedData=True, update_mode=2)  # -> Device, Index
python = GhPythonScript(
    selected=taps.Index,
    points=area.Centroid,
    layers=number_slider_2,
    layerHeight=number_slider_3,
    pointsInLayers=number_slider,
    brushSizeZ=brushsize_height,
    brushWidth=brushsize_width,
    bStyle=brush_style,
    prev=get_global_2)  # -> out, a, new; inputs selected: Int32, points: list of Point3d, pointsInLayers: Int32, prev: Point3d
# ---------- python: Python ----------
"""Provides a scripting component.
    Inputs:
        selected: the point thta was selected/dragged by the user
        points: the list of all points
        layers: number of layers (rows)
        pointsInLayers: number of points in each layer ()columns
        bSize: size of "brush" or user manipulation
        bStyle: size of "brush" or user manipulation
    Output:
        a: The a output variable"""

__author__ = "joyce"
__version__ = "2023.05.22"

import rhinoscriptsyntax as rs

def distXY(p0, p1):
  return (p0.X- p1.X)*(p0.X- p1.X) + (p0.Y- p1.Y)*(p0.Y- p1.Y)#+(p0.Z- p1.Z)*(p0.Z- p1.Z)
  
def dist(p0, p1):
  return (p0.X- p1.X)*(p0.X- p1.X) + (p0.Y- p1.Y)*(p0.Y- p1.Y)+(p0.Z- p1.Z)*(p0.Z- p1.Z)

def colTransform():       
    column = selected%pointsInLayers
#    print(column)
    
#    cols = points[column::pointsInLayers]
#    print[len(cols)]
        
    newX, newY = points[selected].X, points[selected].Y
    print(newX, newY)
    
    for i in range(pointsInLayers):
        if(abs(i-column) < brushWidth*pointsInLayers/360):
            for c in points[i::pointsInLayers]:
                if(not c == points[selected]):
                    if(bStyle == 0):    
                        cdist = max(0, abs(i-column)/(brushWidth/360*pointsInLayers))
                        dist = min(1,abs(c.Z - points[selected].Z)/layerHeight/layers/brushSizeZ)
                    elif(bStyle == 1):
                        dist = pow(min(1,abs(c.Z - points[selected].Z)/layerHeight/layers/brushSizeZ), 2)
                        cdist = pow(max(0, abs(i-column)/(brushWidth/360*pointsInLayers)),2)   
                    
                    weight = min(dist + cdist, 1)
                    c.X =  (newX*(1-weight) + c.X*weight)
                    c.Y =  (newY*(1-weight) + c.Y*weight)
#                    print(dist)
#            print("lin")


print("checking?" + str(selected)  + "prev" + str(prev))
if(selected is not None): 
    new = points[selected]
    print(selected);
    if(prev is None):
        prev = points[selected]
    if(prev is not None):
        if (dist(points[selected],prev)>0.05):
            print("i should do the col transform now")
            colTransform()
    
#        points[selected].X -= 50 
#        points[selected].Y += 50   
a = points
print(new)
#
# ---------- end python ----------
set_global_3 = SetGlobalValue(NewSelected=python.new)
points = PointList(Points=python.a)
panel_5 = Panel(python.out)
msphere_2 = MeshSphere(Base=python.a, Radius=number_slider_4, UCount=10, VCount=20)
panel_6 = Panel(python.new)
new_2 = SetGlobalValue(Global=msphere_2)

pline = PolyLine(Vertices=python.a, Closed=False)
sync_2 = SyncObject(
    GM=pline,
    AlwaysIncludeTextureCoordinates=False,
    Clickable=False,
    DefaultCurveThicknessMillimeters=2.799999952,
    DefaultGlossPercent=0,
    DefaultMaterialColor=RGB(255, 255, 255),
    DefaultSpecularPercent=0,
    Grabbable=False,
    Interactive=False,
    Occlusion=False,
    Outline=False,
    hasSerializedData=True)
