# Grasshopper definition pattern_op.gh (Grasshopper 1.0.7)
# plug-ins: FologramForGrasshopper, Fologram For Grasshopper Utilities

syncparams = SyncParameters(
    augmented_trigger_0_key=number_slider,
    augmented_trigger_1_key=number_slider_4,
    augmented_trigger_2_key=number_slider_2,
    augmented_trigger_3_key=number_slider_3,
    augmented_trigger_4_key=number_slider_6,
    augmented_trigger_5_key=brush_style,
    augmented_trigger_6_key=brushsize_height,
    augmented_trigger_7_key=number_slider_5,
    augmented_trigger_8_key=brushsize_width,
    augmented_trigger_9_key=manipulation_type,
    componentVersion=1,
    num_augmented_triggers=10)

# ---- group: Detect release
connected_devices = ConnectedDevices(device_filter=3, hasSerializedData=True)
track_state = TrackState(Device=connected_devices, hasSerializedData=True, update_mode=1)
state_gate = StateGate(States=track_state)  # -> Release, StateGroup

# ----
number_slider = Slider(79.15, range=0..200)
number_slider_2 = Slider(13, range=1..50)
number_slider_3 = Slider(16, range=1..50)
number_slider_4 = Slider(10, range=0..20)
pt = ConstructPoint(XCoordinate=0, YCoordinate=0, ZCoordinate=0)
get_global = GetGlobalValue(IsDynamicUpdate=True)
manipulation_type = ValueList({"Shape": 0, "Pattern": 1, "Point": 2}, selected="Pattern")
brush_style = ValueList({"Linear": 0, "Exponential": 1}, selected="Linear")
toolpath_unit_generator = GhPythonScript(
    position=pt,
    initialRadius=number_slider,
    layerHeight=number_slider_4,
    nbLayers=number_slider_2,
    nbPointsInLayer=number_slider_3)  # -> out, path; inputs position: Point3d, nbLayers: Int32, nbPointsInLayer: Int32
# ---------- toolpath_unit_generator: Python ----------
__author__ = "sami_"
__version__ = "2022.06.29"

import rhinoscriptsyntax as rs
import math

print(selectedIndex)

path = []
nbPoints = nbPointsInLayer 
radius = initialRadius

vectors = []
for j in range(0, nbLayers):
    for i in range(0, nbPoints):
        angle = 360/nbPoints
        path.append(rs.CreatePoint(position.X + radius*math.cos(i*angle*math.pi/180), position.Y + radius*math.sin(i*angle*math.pi/180), position.Z+layerHeight*j))
# ---------- end toolpath_unit_generator ----------
panel = Panel(get_global)
brushsize_height = Slider(0.212, range=0.001..1)
number_slider_5 = Slider(25, range=0..200)
brushsize_width = Slider(66.895, range=1..90)
get_global_2 = GetGlobalValue(IsDynamicUpdate=False)
get_global_3 = GetGlobalValue(IsDynamicUpdate=True)
number_slider_6 = Slider(3.554, range=0..6)
get_global_4 = GetGlobalValue(IsDynamicUpdate=False)

# ---- group: Update on release
new = GetGlobalValue(IsDynamicUpdate=False)  # disabled
state = SetGlobalValue(Global=new)  # disabled

# ----
panel_2 = Panel(toolpath_unit_generator.out)
msphere = MeshSphere(Base=toolpath_unit_generator.path, Radius=number_slider_6, UCount=10, VCount=20)
set_global = SetGlobalValue(Global=msphere)
area = Area(Geometry=msphere)  # -> Area, Centroid

get_global_5 = GetGlobalValue(IsDynamicUpdate=True)
sync = SyncObject(
    GM=get_global_5,
    AlwaysIncludeTextureCoordinates=False,
    Clickable=True,
    DefaultCurveThicknessMillimeters=2.5,
    DefaultGlossPercent=0,
    DefaultMaterialColor=RGB(201, 73, 155),
    DefaultSpecularPercent=0,
    Grabbable=True,
    Interactive=True,
    Occlusion=False,
    Outline=False,
    hasSerializedData=True)
mesh = Mesh(sync)
area_2 = Area(Geometry=mesh)  # -> Area, Centroid

taps = TrackTaps(
    Devices=flatten(connected_devices),
    Geometry=flatten(sync),
    IncludeEmptyTaps=False,
    hasSerializedData=True,
    update_mode=2)  # -> Device, Index

item = ListItem(List=get_global_5, Index=taps.Index, Wrap=True)  # disabled
area_3 = Area(Geometry=item)  # -> Area, Centroid; disabled
rec = DataRecorder(area_3.Centroid, DataLimit=-10, RecordData=True)  # disabled
set_global_2 = SetGlobalValue(Global=area_3.Centroid)  # disabled
panel_3 = Panel(rec)  # disabled

python = GhPythonScript(
    selected=taps.Index,
    points=area_2.Centroid,
    layers=number_slider_2,
    layerHeight=number_slider_4,
    pointsInLayers=number_slider_3,
    brushSizeZ=brushsize_height,
    brushWidth=brushsize_width,
    bStyle=brush_style,
    manipulation=manipulation_type,
    prev=get_global_2,
    tapStart=get_global_3,
    origin=pt,
    selectedPoints=get_global_4)  # -> out, a, new, selectedPts; inputs selected: Int32, points: list of Point3d, pointsInLayers: Int32, manipulation: Int32, prev: Point3d, tapStart: Point3d, origin: Point3d, selectedPoints: list of Int32
# ---------- python: Python ----------
"""Provides a scripting component.
    Inputs:
        selected: the point thta was selected/dragged by the user
        points: the list of all points
        layers: number of layers (rows)
        pointsInLayers: number of points in each layer ()columns
        bSize: size of "brush" or user manipulation
        bStyle: size of "brush" or user manipulation
    Output:
        a: The a output variable"""

__author__ = "joyce & ana"
__version__ = "2023.05.22"

import rhinoscriptsyntax as rs
from math import sqrt, floor
from Rhino.Geometry import Point3d

def distXY(p0, p1):
  return sqrt((p0.X- p1.X)*(p0.X- p1.X) + (p0.Y- p1.Y)*(p0.Y- p1.Y))#+(p0.Z- p1.Z)*(p0.Z- p1.Z)
  
def dist(p0, p1):
  return sqrt((p0.X- p1.X)*(p0.X- p1.X) + (p0.Y- p1.Y)*(p0.Y- p1.Y)+(p0.Z- p1.Z)*(p0.Z- p1.Z))

def colTransform():       
    column = selected%pointsInLayers
#    print(column)
    
#    cols = points[column::pointsInLayers]
#    print[len(cols)]
        
    newX, newY = points[selected].X, points[selected].Y
    print(newX, newY)
    
    for i in range(pointsInLayers):
        if(abs(i-column) < brushWidth*pointsInLayers/360):
            for c in points[i::pointsInLayers]:
                if(not c == points[selected]):
                    if(bStyle == 0):    
                        cdist = max(0, abs(i-column)/(brushWidth/360*pointsInLayers))
                        dist = min(1,abs(c.Z - points[selected].Z)/layerHeight/layers/brushSizeZ)
                    elif(bStyle == 1):
                        dist = pow(min(1,abs(c.Z - points[selected].Z)/layerHeight/layers/brushSizeZ), 2)
                        cdist = pow(max(0, abs(i-column)/(brushWidth/360*pointsInLayers)),2)   
                    
                    weight = min(dist + cdist, 1)
                    c.X =  (newX*(1-weight) + c.X*weight)
                    c.Y =  (newY*(1-weight) + c.Y*weight)
#                    print(dist)
#            print("lin")

def shapeTransform():       
    column = selected%pointsInLayers    
    
#   new distance calculation
#        based on displacement from past position
    disp = dist(pastpos, points[selected])
    
#    check if new adius is smaller --> displacement shoudld be negative
    pasth, newh = dist(Point3d(0,0,0), pastpos), dist(Point3d(0,0,0), points[selected]) 
    if(pasth > newh):
        disp *= -1
    print(disp)
    
    if(disp != 0):
        zSize = floor(brushSizeZ*layerHeight)*pointsInLayers
        print(brushSizeZ*layerHeight, zSize)
        lowerColBound = max(0,int(selected-int(floor(pointsInLayers/2 + zSize))))
        upperColBound =  min(int(pointsInLayers*layers), int(floor(pointsInLayers/2 + zSize + selected)))
        print("lower", lowerColBound, "upper", upperColBound)
        for c in points[lowerColBound:upperColBound:]:
            if(c != points[selected]):
                oldx, oldy, oldz = c.X, c.Y, c.Z
            else:
                oldx, oldy, oldz = pastpos.X, pastpos.Y, pastpos.Z
            oldh = sqrt(pow(oldx,2) + pow(oldy,2))
           
            h = (sqrt(pow(oldx,2) + pow(oldy,2)) + disp)/oldh
            w = 1
            
            zdist = abs(c.Z - points[selected].Z)
            if(zdist >= layerHeight):
#               for exp
                if(bStyle==1):
                    w = layerHeight/(zdist+1)
#               for lin 
                if(bStyle==0):
                    w = (zSize + layerHeight - zdist)/(zSize+layerHeight)
                print('shape params', zSize/pointsInLayers, zdist, w)
            
            newX, newY = (oldx*(2-w) + oldx*h*w)/2, (oldy*(2-w) + oldy*h*w)/2
            
        #    c = Point3D(newX, newY, oldZ)
            c.X = newX 
            c.Y = newY
            c.Z = oldz

#MAIN

##TODO: replace with actual past (initial) position of selected point before manipulation
if (tapStart is not None):
    pastpos = Point3d(tapStart)

# Make persistent value to keep track of last value (LV) of tapStart 
if "tapStartLV" not in globals():
    tapStartLV = tapStart
    
# Check that current value is different from last value
if tapStartLV == tapStart:
    tapStartChenged = False
else:
    tapStartChenged = True
    tapStartLV = tapStart

## remove when testing through fologram
#points[selected].X *= .8
#points[selected].Y *= .8

#print("checking?" + str(selected)  + "prev" + str(prev))
def asignSelectedPoints(selected):
    if (selectedPoints is None):
        return [selected]
    elif selected not in selectedPoints:
        return selectedPoints.append(selected)
    else:
        return selectedPoints

patternPoints = []
if(selected is not None):
    new = points[selected]
    print(manipulation)
    if (manipulation == 1):
        print(selected, selectedPoints)
        selectedPts = asignSelectedPoints(selected)
    else:
        selectedPts = []
    if(prev is None):
        prev = points[selected]
    if(prev is not None):
        if ((dist(points[selected],prev)>0.05) and (not tapStartChenged)):
            print("i should do the col transform now")
            if(manipulation ==0):
                shapeTransform()
            elif(manipulation == 2):
                colTransform()
      

a = points
# ---------- end python ----------
rec_2 = DataRecorder(python.out, DataLimit=-10, RecordData=True)
set_global_3 = SetGlobalValue(SelectedPoints=python.selectedPts)
set_global_4 = SetGlobalValue(NewSelected=python.new)
points = PointList(Points=python.a)
panel_4 = Panel(python.selectedPts)
panel_5 = Panel(rec_2)
msphere_2 = MeshSphere(Base=python.a, Radius=number_slider_6, UCount=10, VCount=20)
new_2 = SetGlobalValue(Global=msphere_2)

pline = PolyLine(Vertices=python.a, Closed=False)
sync_2 = SyncObject(
    GM=pline,
    AlwaysIncludeTextureCoordinates=False,
    Clickable=False,
    DefaultCurveThicknessMillimeters=2.799999952,
    DefaultGlossPercent=0,
    DefaultMaterialColor=RGB(255, 255, 255),
    DefaultSpecularPercent=0,
    Grabbable=False,
    Interactive=False,
    Occlusion=False,
    Outline=False,
    hasSerializedData=True)
