# Grasshopper definition symmetrical_op_prev_pos_distributed.gh (Grasshopper 1.0.7)
# plug-ins: Fologram For Grasshopper Utilities, FologramForGrasshopper

number_slider = Slider(10, range=1..50)
number_slider_2 = Slider(56.278, range=0..200)
number_slider_3 = Slider(12, range=1..50)
brushsize_height = Slider(0.292, range=0.001..1)
manipulation_type = ValueList({"Shape": 0, "Pattern": 1, "Point": 2}, selected="Point")
exponential_shape = ValueList({"Squared": 1, "Square Root": 0}, selected="Squared")
brushsize_width = Slider(28.287, range=1..90)
brush_style = ValueList({"Linear": 0, "Exponential": 1}, selected="Linear")
number_slider_4 = Slider(3, range=0..20)
X = Slider(0, range=-1000..1000)
Y = Slider(0, range=-1000..1000)
Z = Slider(12, range=-20..100)
syncparams = SyncParameters(
    augmented_trigger_0_key=number_slider_2,
    augmented_trigger_1_key=number_slider_4,
    augmented_trigger_20_key=z0,
    augmented_trigger_21_key=number_slider_9,
    augmented_trigger_22_key=number_slider_7,
    augmented_trigger_23_key=number_slider_8,
    augmented_trigger_26_key=nozzle_diam_mm,
    augmented_trigger_27_key=print_speed_mm_s,
    augmented_trigger_28_key=extrusion_multiplier,
    augmented_trigger_29_key=layer_height_mm,
    augmented_trigger_2_key=number_slider_3,
    augmented_trigger_3_key=number_slider,
    augmented_trigger_47_key=X,
    augmented_trigger_48_key=Y,
    augmented_trigger_49_key=Z,
    augmented_trigger_4_key=number_slider_6,
    augmented_trigger_51_key=exponential_shape,
    augmented_trigger_5_key=brush_style,
    augmented_trigger_6_key=brushsize_height,
    augmented_trigger_7_key=number_slider_5,
    augmented_trigger_8_key=brushsize_width,
    augmented_trigger_9_key=manipulation_type,
    componentVersion=1,
    num_augmented_triggers=52)

# ---- group: Detect release
connected_devices = ConnectedDevices(device_filter=3, hasSerializedData=True)
track_state = TrackState(Device=connected_devices, hasSerializedData=True, update_mode=1)
state_gate = StateGate(States=track_state)  # -> Release, StateGroup

# ----
pt = ConstructPoint(XCoordinate=X, YCoordinate=Y, ZCoordinate=Z)
toolpath_unit_generator = GhPythonScript(
    position=pt,
    initialRadius=number_slider_2,
    layerHeight=number_slider_4,
    nbLayers=number_slider_3,
    nbPointsInLayer=number_slider)  # -> out, path; inputs position: Point3d, nbLayers: Int32, nbPointsInLayer: Int32
# ---------- toolpath_unit_generator: Python ----------
__author__ = "sami_"
__version__ = "2022.06.29"

import rhinoscriptsyntax as rs
import math

print(selectedIndex)

path = []
nbPoints = nbPointsInLayer 
radius = initialRadius

vectors = []
for j in range(0, nbLayers):
    for i in range(0, nbPoints):
        angle = 360/nbPoints
        path.append(rs.CreatePoint(position.X + radius*math.cos(i*angle*math.pi/180), position.Y + radius*math.sin(i*angle*math.pi/180), position.Z+layerHeight*j))
# ---------- end toolpath_unit_generator ----------
number_slider_5 = Slider(25, range=0..200)
get_global = GetGlobalValue(IsDynamicUpdate=False)
get_global_2 = GetGlobalValue(IsDynamicUpdate=True)
number_slider_6 = Slider(3, range=0..6)

# ---- group: Update on release
new = GetGlobalValue(IsDynamicUpdate=False)  # disabled
state = SetGlobalValue(Global=new)  # disabled

# ----
panel = Panel(toolpath_unit_generator.out)
msphere = MeshSphere(Base=toolpath_unit_generator.path, Radius=number_slider_6, UCount=10, VCount=20)

# ----
# Potterbot Config
extrusion_multiplier = Slider(3, range=0..10)
print_speed_mm_s = Slider(40, range=0..200)
layer_height_mm = Slider(4, range=0..7)
nozzle_diam_mm = Slider(8, range=0..8)
box = DomainBox(Base=PlaneXY(0, 0, 0), X="415", Y="405", Z="500")

number_slider_7 = Slider(0, range=-1000..300)
number_slider_8 = Slider(3, range=0..10)
z0 = Slider(0, range=-20..10)
number_slider_9 = Slider(0, range=-1000..300)
pt_2 = ConstructPoint(XCoordinate=number_slider_9, YCoordinate=number_slider_7, ZCoordinate=z0)
base = Base(
    position=pt_2,
    nblayers=number_slider_8,
    nbpoints=number_slider,
    layerheight=layer_height_mm,
    thickness=nozzle_diam_mm,
    radius=number_slider_2)  # -> out, path

set_global = SetGlobalValue(Global=msphere)
area = Area(Geometry=msphere)  # -> Area, Centroid
get_global_3 = GetGlobalValue(IsDynamicUpdate=True)
area_2 = Area(Geometry=get_global_3)  # -> Area, Centroid
merge = Merge(Data1=flatten(base.path), Data2=flatten(area_2.Centroid))
center_print = CenterPrint(path=merge, domainbox=box)
g_code_generator = GCodeGenerator(path=center_print, layerheight=layer_height_mm, nozzlediameter=nozzle_diam_mm, printspeed=print_speed_mm_s)  # -> gcode, nbtubes, clayheight

# ---- group: Renders Path Preview
pline = PolyLine(Vertices=center_print, Closed=False)

# ---- group: Clay/tube usage
# (430mm usable clay length)
# Number of tubes
# Clay height (mm)
panel_2 = Panel(g_code_generator.nbtubes)
panel_3 = Panel(g_code_generator.clayheight)

# ----
panel_4 = Panel(g_code_generator.gcode)

get_global_4 = GetGlobalValue(IsDynamicUpdate=True)
sync = SyncObject(
    GM=get_global_4,
    AlwaysIncludeTextureCoordinates=False,
    Clickable=True,
    DefaultCurveThicknessMillimeters=2.5,
    DefaultGlossPercent=0,
    DefaultMaterialColor=RGB(201, 73, 155),
    DefaultSpecularPercent=0,
    Grabbable=True,
    Interactive=True,
    Occlusion=False,
    Outline=False,
    hasSerializedData=True)
mesh = Mesh(sync)
area_3 = Area(Geometry=mesh)  # -> Area, Centroid

taps = TrackTaps(
    Devices=flatten(connected_devices),
    Geometry=flatten(sync),
    IncludeEmptyTaps=False,
    hasSerializedData=True,
    update_mode=2)  # -> Device, Index

item = ListItem(List=get_global_4, Index=taps.Index, Wrap=True)  # disabled
area_4 = Area(Geometry=item)  # -> Area, Centroid; disabled
rec = DataRecorder(area_4.Centroid, DataLimit=-10, RecordData=True)  # disabled
set_global_2 = SetGlobalValue(Global=area_4.Centroid)  # disabled
panel_5 = Panel(rec)  # disabled

python = GhPythonScript(
    selected=taps.Index,
    points=area_3.Centroid,
    layers=number_slider_3,
    layerHeight=number_slider_4,
    pointsInLayers=number_slider,
    brushSizeZ=brushsize_height,
    brushWidth=brushsize_width,
    bStyle=brush_style,
    manipulation=manipulation_type,
    prev=get_global,
    tapStart=get_global_2,
    origin=pt,
    expShape=exponential_shape)  # -> out, a, new; inputs selected: Int32, points: list of Point3d, pointsInLayers: Int32, manipulation: Int32, prev: Point3d, tapStart: Point3d, origin: Point3d
# ---------- python: Python ----------
"""Provides a scripting component.
    Inputs:
        selected: the point thta was selected/dragged by the user
        points: the list of all points
        layers: number of layers (rows)
        pointsInLayers: number of points in each layer ()columns
        bSize: size of "brush" or user manipulation
        bStyle: size of "brush" or user manipulation
    Output:
        a: The a output variable"""

__author__ = "joyce & ana"
__version__ = "2023.05.22"

import rhinoscriptsyntax as rs
from math import sqrt, floor
from Rhino.Geometry import Point3d

def distXY(p0, p1):
  return sqrt((p0.X- p1.X)*(p0.X- p1.X) + (p0.Y- p1.Y)*(p0.Y- p1.Y))#+(p0.Z- p1.Z)*(p0.Z- p1.Z)
  
def dist(p0, p1):
  return sqrt((p0.X- p1.X)*(p0.X- p1.X) + (p0.Y- p1.Y)*(p0.Y- p1.Y)+(p0.Z- p1.Z)*(p0.Z- p1.Z))

def colTransform():       
    column = selected%pointsInLayers
#    print(column)
    
#    cols = points[column::pointsInLayers]
#    print[len(cols)]
        
    newX, newY = points[selected].X, points[selected].Y
    print(newX, newY)
    
    for i in range(pointsInLayers):
        if(abs(i-column) < brushWidth*pointsInLayers/360):
            for c in points[i::pointsInLayers]:
                if(not c == points[selected]):
                    if(bStyle == 0):    
                        cdist = max(0, abs(i-column)/(brushWidth/360*pointsInLayers))
                        dist = min(1,abs(c.Z - points[selected].Z)/layerHeight/layers/brushSizeZ)
                    elif(bStyle == 1):
                        dist = pow(min(1,abs(c.Z - points[selected].Z)/layerHeight/layers/brushSizeZ), 2)
                        cdist = pow(max(0, abs(i-column)/(brushWidth/360*pointsInLayers)),2)   
                    
                    weight = min(dist + cdist, 1)
                    c.X =  (newX*(1-weight) + c.X*weight)
                    c.Y =  (newY*(1-weight) + c.Y*weight)
#                else:
#                    c.Z = pastpos.Z
                    
#                    print(dist)
#            print("lin")

def shapeTransform():       
    print(brushSizeZ*layers*layerHeight) 
    column = selected%pointsInLayers    
    
#   new distance calculation
#        based on displacement from past position
    disp = dist(pastpos, points[selected])
    
#    check if new adius is smaller --> displacement shoudld be negative
    pasth, newh = dist(Point3d(0,0,0), pastpos), dist(Point3d(0,0,0), points[selected]) 
    if(pasth > newh):
        disp *= -1
    print(disp)
    
    if(disp != 0):
        zSize = floor(brushSizeZ*layers*layerHeight)*pointsInLayers
        print(brushSizeZ*layerHeight, zSize)
        lowerColBound = max(0,int(selected-int(floor(pointsInLayers/2 + zSize))))
        upperColBound =  min(int(pointsInLayers*layers), int(floor(pointsInLayers/2 + zSize) + selected))
        print("lower", lowerColBound, "upper", upperColBound)
        for c in points[lowerColBound:upperColBound:]:
            if(c != points[selected]):
                oldx, oldy, oldz = c.X, c.Y, c.Z
            else:
                oldx, oldy, oldz = pastpos.X, pastpos.Y, pastpos.Z
            oldh = sqrt(pow(oldx,2) + pow(oldy,2))
           
            h = (sqrt(pow(oldx,2) + pow(oldy,2)) + disp)/oldh
            w = 1
            
            zdist = abs(c.Z - points[selected].Z)
            if(zdist >= layerHeight):
                zdist = zdist/layerHeight
#               for exp
                if(bStyle==1):
                    if (expShape == 1):
                        w = 1 - pow((zdist)/(zSize/pointsInLayers + 1), 2)
                    else:
                        w = 1 - sqrt((zdist)/(zSize/pointsInLayers + 1))
#               for lin 
                if(bStyle==0):
                    w = 1 - (zdist)/(zSize/pointsInLayers + 1)
                print(zSize/pointsInLayers, zdist, w)
            
            newX, newY = (oldx*(2-w) + oldx*h*w)/2, (oldy*(2-w) + oldy*h*w)/2
            
        #    c = Point3D(newX, newY, oldZ)
            c.X = newX 
            c.Y = newY
            c.Z = oldz

#MAIN

##TODO: replace with actual past (initial) position of selected point before manipulation
if (tapStart is not None):
    pastpos = Point3d(tapStart)

# Make persistent value to keep track of last value (LV) of tapStart 
if "tapStartLV" not in globals():
    tapStartLV = tapStart
    
# Check that current value is different from last value
if tapStartLV == tapStart:
    tapStartChenged = False
else:
    tapStartChenged = True
    tapStartLV = tapStart

## remove when testing through fologram
#points[selected].X *= .8
#points[selected].Y *= .8

#print("checking?" + str(selected)  + "prev" + str(prev))
if(selected is not None): 
    new = points[selected]
    if(prev is None):
        prev = points[selected]
    if(prev is not None):
        if ((dist(points[selected],prev)>0.05) and (not tapStartChenged)):
            print("i should do the col transform now")
            if(manipulation ==0):
                shapeTransform()
            elif(manipulation == 2):
                colTransform()
      

a = points
# ---------- end python ----------
rec_2 = DataRecorder(python.out, DataLimit=-10, RecordData=True)
set_global_3 = SetGlobalValue(NewSelected=python.new)
points = PointList(Points=python.a)
panel_6 = Panel(python.new)
panel_7 = Panel(python.out)
msphere_2 = MeshSphere(Base=python.a, Radius=number_slider_6, UCount=10, VCount=20)
new_2 = SetGlobalValue(Global=msphere_2)

pline_2 = PolyLine(Vertices=python.a, Closed=False)
sync_2 = SyncObject(
    GM=pline_2,
    AlwaysIncludeTextureCoordinates=False,
    Clickable=False,
    DefaultCurveThicknessMillimeters=2.799999952,
    DefaultGlossPercent=70,
    DefaultMaterialColor=RGB(145, 122, 255),
    DefaultSpecularPercent=61,
    Grabbable=False,
    Interactive=False,
    Occlusion=False,
    Outline=True,
    hasSerializedData=True)

# ==== cluster Base: The base is circular and its specific shape is defined by its nbPointInLayer.
position = ClusterInput()  # point (x, y, z) to position form center
nblayers = ClusterInput()  # number of layers in form
layerheight = ClusterInput()  # layer height, should be around half the nozzle size
nbpoints = ClusterInput()  # number of points per layer
thickness = ClusterInput()  # layer thickness, should be around the nozzle size used to print
radius = ClusterInput()  # the radius of the base
base = GhPythonScript(position=position, nbLayers=nblayers, nbPoints=nbpoints, layerHeight=layerheight, thickness=thickness, radius=radius)  # -> out, path; inputs position: Point3d, nbLayers: Int32, nbPoints: Int32
# ---------- base: Python ----------
__author__ = "sami_"
__version__ = "2022.08.08"

import rhinoscriptsyntax as rs
import math
import Rhino
from System import *
from Rhino import *
from Rhino.DocObjects import *
from Rhino.Geometry import *
from Rhino.Input import *
from Rhino.Input.Custom import *
from Rhino.Commands import *
from scriptcontext import doc

path = []
curves = []
contour = []
#p0 = rs.CurveStartPoint(curve)
#radius = p0.X
currentHeight = position.Z

#vectors = []
for j in range(0, nbLayers):
    contour = []
    if j != 1:
        for i in range(0, nbPoints):
            angle = 360/nbPoints
            #print(scaleFunction[j])
            #path.append(rs.CreatePoint(position.X+(radius+scaleFunction[j]+radiusFunction[i])*math.cos(i*angle*math.pi/180 + rotateFunction[j]*math.pi/180)+translateFunction[j].X, position.Y+(radius + scaleFunction[j] + +radiusFunction[i])*math.sin(i*angle*math.pi/180+rotateFunction[j]*math.pi/180)+translateFunction[j].Y, position.Z+layerHeight*j)) #*layerHeight/nbPoints
            path.append(rs.CreatePoint(position.X+radius*math.cos(i*angle*math.pi/180), position.Y+radius*math.sin(i*angle*math.pi/180), position.Z+layerHeight*j)) #*layerHeight/nbPoints
            contour.append(rs.CreatePoint(path[len(path) - 1].X-position.X, path[len(path) - 1].Y-position.Y, 0))
            #contour.append(path[len(path) - 1])
            #vectors.append(rs.VectorUnitize(rs.VectorCreate(rs.CreatePoint(0,0,0), rs.CreatePoint(math.cos(i*angle*math.pi/180), math.sin(i*angle*math.pi/180), 0))))
        path.append(path[len(path) - nbPoints] )
        contour.append(rs.CreatePoint(path[len(path) - 1].X-position.X, path[len(path) - 1].Y-position.Y, 0))
        #contour.append(path[len(path) - 1])
    
    if j % 2 == 0:
        a = rs.AddPolyline(contour)
        centroid = rs.CurveAreaCentroid(a)
        centroid = centroid[0]
        #centroid = position
        print(centroid)
        c = rs.CurveClosestPoint(a, centroid)
        point = rs.EvaluateCurve(a, c)
        g = rs.VectorAdd(point, -centroid)
        print(g)
        #center = rs.CreatePoint(centroid.X, centroid.Y, 0)
        d = rs.VectorLength(g)
        div = d / thickness
        srf = rs.AddPlanarSrf([a])
        plane = rs.CurvePlane(a)
        crv= rs.coercecurve(a)
        St = Rhino.Geometry.CurveOffsetCornerStyle.Sharp
        center = rs.AddPoint(position.X,position.Y,0)
        
        for i in range(1,int(div)):
            #series.append(i*thickness)
            #print(i*thickness)
            #print(centroid)
            #print(rs.CurvePoints(a)[0])
            #print(i)
            #curveOff = rs.OffsetCurve(a,center,-0.001, normal=None, style=1)
            scaleRatio = (radius - i*thickness)/radius
            """curve0 = rs.ScaleObject(a, center, (scaleRatio, scaleRatio, 0), True)
            curve = rs.MoveObject(curve0, rs.AddPoint(0,0,currentHeight))"""
            #b = rs.AddCurve(a)
            #curve = rs.coercecurve(b)
            #curve[0].Scale(i*thickness/radius)
            #print()
            curve = crv.Offset(plane, -0.001, 0.01, St)
            
            curve[0].Scale(scaleRatio)
            curve[0].Translate(position.X,position.Y,currentHeight)
            #curve = crv.OffsetOnSurface(rs.coercesurface(srf), i*thickness, 100)
            #print(curve)
            #print(len(curve))
            #ccurve = rs.AddCurve(curve[0])
            curves.append(curve[0])
            #for p in rs.CurvePoints(ccurve):
            if curve != None:
                #for p in rs.CurvePoints(curve):
                for p in range(0, nbPoints):
                    path.append(curve[0].PointAt(p))
            else:
                #print(-i*thickness)
                print()
    else:
        pp1 = rs.CreatePoint(path[0].X - position.X, path[0].Y-position.X, path[0].Z)
        pp2 = rs.CreatePoint(path[0].X-2*radius - position.X, path[0].Y-position.X, path[0].Z)
        srf = rs.AddPlanarSrf([a])
        geo = rs.coercegeometry(srf)
        path2 = []
        contours = Brep.CreateContourCurves(geo, pp1, pp2, thickness)
        switch = True
        for cc in contours:
            start = cc.PointAtNormalizedLength(0)
            end = cc.PointAtNormalizedLength(1)
            if switch:
                path.append(rs.CreatePoint(start.X + position.X, start.Y + position.Y, start.Z + currentHeight))
                path.append(rs.CreatePoint(end.X + position.X, end.Y + position.Y, end.Z + currentHeight))
                switch = False
            else:
                path.append(rs.CreatePoint(end.X+ position.X, end.Y+ position.Y, end.Z + currentHeight))
                path.append(rs.CreatePoint(start.X+ position.X, start.Y+ position.Y, start.Z + currentHeight))
                switch = True
    currentHeight += layerHeight


"""path1 = []
a = rs.AddPolyline(path)
centroid = rs.CurveAreaCentroid(a)
centroid = centroid[0]
print(centroid)
c = rs.CurveClosestPoint(a, centroid)
point = rs.EvaluateCurve(a, c)
g = rs.VectorAdd(point, -centroid)
d = rs.VectorLength(g)
div = d / thickness
srf = rs.AddPlanarSrf([a])

for i in range(1,int(div)):
    #series.append(i*thickness)
    #print(i*thickness)
    #print(centroid)
    #print(rs.CurvePoints(a)[0])
    #print(i)
    curve = rs.OffsetCurve(a,centroid,i*thickness)
    curves.append(rs.coercecurve(curve))
    for p in rs.CurvePoints(curve):
        path1.append(p)
    #curves.append(curve)
    #curve = rs.OffsetCurve(a, 
#curves = rs.OffsetCurve(a,centroid,thickness)
"""

"""pp1 = path[0]
pp2 = rs.CreatePoint(path[0].X-2*radius, path[0].Y, path[0].Z)
srf = rs.AddPlanarSrf([a])
geo = rs.coercegeometry(srf)
path2 = []
contours = Brep.CreateContourCurves(geo, pp1, pp2, thickness)
switch = True
for cc in contours:
    start = cc.PointAtNormalizedLength(0)
    end = cc.PointAtNormalizedLength(1)
    if switch:
        path2.append(rs.CreatePoint(start.X, start.Y, start.Z + layerHeight))
        path2.append(rs.CreatePoint(end.X, end.Y, end.Z + layerHeight))
        switch = False
    else:
        path2.append(rs.CreatePoint(end.X, end.Y, end.Z + layerHeight))
        path2.append(rs.CreatePoint(start.X, start.Y, start.Z + layerHeight))
        switch = True"""
# ---------- end base ----------
path = ClusterOutput(base.path)  # ordered array of points (point3d)
out = ClusterOutput(base.out)  # console output

# ==== cluster CenterPrint: Move print to center of input box.
path = ClusterInput()
domainbox = ClusterInput()

# ----
# Center print on the bed
pline = PolyLine(Vertices=path, Closed=False)
box = EvaluateBox(Box=pline, UParameter="0.5", VParameter="0.5", WParameter="0")  # -> Plane, Point, Include
box_2 = EvaluateBox(Box=domainbox, UParameter="0.5", VParameter="0.5", WParameter="0")  # -> Plane, Point, Include
vec2pt = Vector2Pt(PointA=box.Point, PointB=box_2.Point, Unitize=False)  # -> Vector, Length
move = Move(Geometry=path, Motion=vec2pt.Vector)  # -> Geometry, Transform

path_2 = ClusterOutput(move.Geometry)

# ==== cluster GCodeGenerator
nozzlediameter = ClusterInput()
printspeed = ClusterInput()
path = ClusterInput()
layerheight = ClusterInput()

# ---- group: Extrusion
pline = PolyLine(Vertices=path, Closed=False)
explode = Explode(Curve=pline, Recursive=True)  # -> Segments, Vertices
len = Length(Curve=explode.Segments)
py_extrusion = GhPythonScript(LayerHeight=layerheight, NozzleWidth=nozzlediameter, SegmentLen=len)  # -> E
# ---------- py_extrusion: Python ----------
__author__ = "mert_toka"
__version__ = "2022.04.29"

import rhinoscriptsyntax as rs
import math

# input
NozzleWidth
LayerHeight
SegmentLen

# output
E = 0

E = SegmentLen*LayerHeight/NozzleWidth * (4/math.pi + LayerHeight/NozzleWidth)
#E = (4*LayerHeight*SegmentLen*ExtrusionMultiplier) / (math.pi*NozzleWidth)
# ---------- end py_extrusion ----------
ins = InsertItems(List=py_extrusion, Item="0", Indices="0", Wrap=True)
ma = MassAddition(Input=ins)  # -> Result, PartialResults

# ---- group: XYZ
pdecon = Deconstruct(Point=path)  # -> XComponent, YComponent, ZComponent

# ---- group: Feedrate
multiplication = Multiplication(A=printspeed, B="60")
merge = Merge(Data1="10000", Data2=multiplication)  # -> flatten(Result)

# ----
lastdex = LastIndex(List=ma.PartialResults)
py_adjustext = GhPythonScript(extrusions=py_extrusion)  # -> modE; inputs extrusions: list
# ---------- py_adjustext: Python ----------
__author__ = "mert_"
__version__ = "2022.10.18"

import rhinoscriptsyntax as rs

# Input
extrusions

min = 0.8
max = 1.5

# Output
modE = []

def map(value, istart, istop, ostart, ostop):
    return ostart + (ostop - ostart) * ((value - istart) / (istop - istart))

maxIdx = len(extrusions)
midIdx = maxIdx*0.5
for i, e in enumerate(extrusions):
    modE.append(e*map(i, 0, maxIdx-1, max, min))
    
#    if i < midIdx:
#        modE.append(e*map(i, 0, midIdx, max, min))
#    else:
#        modE.append(e*map(i, midIdx, maxIdx, min, max))
# ---------- end py_adjustext ----------
item = ListItem(List=ma.PartialResults, Index=lastdex, Wrap=True)
expression = Expression(x=nozzlediameter, y=item, Expression="((x/2)^2*y)/((95.5/2)^2)/430")

# ---- group: Extrusion Multiplier for correct filament thickness
expression_2 = Expression(x=nozzlediameter, Expression="(x/1.91)^2")
multiplication_2 = Multiplication(A=ma.PartialResults, B=expression_2)

# ----
multiplication_3 = Multiplication(A=expression, B=430)
p_roundgcode = GhPythonScript(f=merge, x=pdecon.XComponent, y=pdecon.YComponent, z=pdecon.ZComponent, e=multiplication_2)  # -> f, x, y, z, e
# ---------- p_roundgcode: Python ----------
__author__ = "mert_toka"
__version__ = "2022.02.02"

import rhinoscriptsyntax as rs

_x = int(x*100)/100.0
_y = int(y*100)/100.0
_z = int(z*100)/100.0
_e = int(e*10000)/10000.0
_f = int(f*100)/100.0
# ---------- end p_roundgcode ----------
nbtubes = ClusterOutput(expression)
clayheight = ClusterOutput(multiplication_3)
concat = Concatenate(
    FragmentI="G1",
    FragmentH=" F",
    FragmentJ=p_roundgcode.f,
    FragmentA=" X",
    FragmentB=p_roundgcode.x,
    FragmentC=" Y",
    FragmentD=p_roundgcode.y,
    FragmentE=" Z",
    FragmentF=p_roundgcode.z,
    FragmentG=" E",
    FragmentK=p_roundgcode.e)  # -> flatten(Result)
panel = Panel(concat)
panel_2 = Panel(""";;; === END GCODE ===
M83 ;Set to Relative Extrusion Mode
G28 Z ;Home Z
; === DEPRESSURIZE ===
G91
G91
G1 E-1300 F4000
G90
G90""")
panel_3 = Panel(""";;; START GCODE ;;;
M82 ;absolute extrusion mode
G28 ;Home
G1 X207.5 Y202.5 Z20 F10000 ;Move X and Y to center, Z to 20mm high
G1 E4000 F40000 ; !!Prime Extruder
G92 E0
G1 F30000 E-150
;;; ======""")
merge_2 = Merge(Data1=panel_3, Data2=panel, Data3=panel_2)  # -> flatten(Result)
gcode = ClusterOutput(merge_2)
